vi "index.gviweb"   [G Web Development Software 22.3.0]
outputs:
  "Temperature outdoor": i32
  "Humidity indoor": i32
panel controls:
  "Main light": bool
  "Ventilation": bool
  "stop": bool
  "Main light ON threshold": u32
  "Ventilation ON humidity treshhold": u32
  "Autoenabled light": bool
  "Autoenabled ventilation": bool
  "Main light switch pin": u32
  "Main fan switch pin": u32
  "Roof sensor echo pin": u32
  "Roof sensor data pin": u32
  "Outdoor temp pin": u32
  "Indoor light sensor pin": u32
  "Closed roof distance": u32
  "Light on threshold": u32
  "Save settings": bool
panel indicators:
  "Temperature indoor": f64
  "Roof window is open": bool
  "The main light is on": bool
  "Chart": f64[][]
types:
  T1 = cluster{"main_light_pin": u32, "main_fan_pin": u32, "outdoor_temp_pin": u32, "indoor_light_sensor_pin": u32, "roof_sensor_echo_pin": u32, "roof_sensor_data_pin": u32, "closed_roof_distance": u32, "light_on_threshold": u32, "ventilation_on_auto_treshold": u32, "main_light_on_auto_treshold": u32, "ventilation_on_auto_mode": bool, "light_on_auto_mode": bool}
uses:
  NI::HTTP::Open HTTP Handle.gvi
  NI::HTTP::GET.gvi
  NI::HTTP::Close HTTP Handle.gvi
  NI::HTTP::POST Buffer.gvi
diagram:
  while {
    call "Open HTTP Handle.gvi"() -> (client handle out=w1, error out=w2)
    call "GET.gvi"(client handle=w1, url="http://192.168.0.14:80/warehouse/temp-outdoor-sensor", error in=w2) -> (client handle out=w3, body=w4, error out=w5)
    Unflatten From Json(JSON string=w4, error in (no error)=w5, type and defaults=cluster{"temperature": i32} {all zero or empty}) -> (error out=w6, value=w7)
    call "Close HTTP Handle.gvi"(client handle=w3, error in=w6)
    Property Node(instance in=w7) -> ("temperature"=w8)
    $"Temperature outdoor" <- w8
    call "Open HTTP Handle.gvi"() -> (client handle out=w9, error out=w10)
    call "GET.gvi"(client handle=w9, url="http://192.168.0.14:80/warehouse/temp-indoor-sensor", error in=w10) -> (client handle out=w11, body=w12, error out=w13)
    Unflatten From Json(JSON string=w12, error in (no error)=w13, type and defaults=cluster{"temp-indoor": f64} {all zero or empty}) -> (error out=w14, value=w15)
    call "Close HTTP Handle.gvi"(client handle=w11, error in=w14)
    Property Node(instance in=w15) -> ("temp-indoor"=w16)
    $"Temperature indoor" <- w16
    To Double Precision Float(number=w8) -> w17
    Build Array(w17) -> w18
    Build Array(w16) -> w19
    call "Open HTTP Handle.gvi"() -> (client handle out=w20, error out=w21)
    call "GET.gvi"(client handle=w20, url="http://192.168.0.14:80/warehouse/humidity-indoor-sensor", error in=w21) -> (client handle out=w22, body=w23, error out=w24)
    Unflatten From Json(JSON string=w23, error in (no error)=w24, type and defaults=cluster{"absolute-humidity": i32} {all zero or empty}) -> (error out=w25, value=w26)
    Property Node(instance in=w26) -> ("absolute-humidity"=w27)
    To Double Precision Float(number=w27) -> w28
    Build Array(w28) -> w29
    Build Array(w19, w29, w18) -> w30
    Transpose 2D Array(2D array=w30) -> (transposed array=w31)
    $Chart <- w31
    call "Close HTTP Handle.gvi"(client handle=w22, error in=w25)
    Wait(time to wait=1000)
    $"Humidity indoor" <- w27
    call "Open HTTP Handle.gvi"() -> (client handle out=w32, error out=w33)
    call "GET.gvi"(client handle=w32, url="http://192.168.0.14:80/warehouse/light-sensor-indoor", error in=w33) -> (client handle out=w34, body=w35, error out=w36)
    Unflatten From Json(JSON string=w35, error in (no error)=w36, type and defaults=cluster{"is-light-on": bool} {all zero or empty}) -> (error out=w37, value=w38)
    call "Close HTTP Handle.gvi"(client handle=w34, error in=w37)
    Property Node(instance in=w38) -> ("is-light-on"=w39)
    $"The main light is on" <- w39
    call "Open HTTP Handle.gvi"() -> (client handle out=w40, error out=w41)
    call "GET.gvi"(client handle=w40, url="http://192.168.0.14:80/warehouse/roof-window-sensor", error in=w41) -> (client handle out=w42, body=w43, error out=w44)
    w45 = cluster{"roof_window_status": bool} {"roof_window_status"=TRUE}
    Unflatten From Json(JSON string=w43, error in (no error)=w44, type and defaults=w45) -> (error out=w46, value=w47)
    call "Close HTTP Handle.gvi"(client handle=w42, error in=w46)
    Property Node(instance in=w47) -> ("roof_window_status"=w48)
    $"Roof window is open" <- w48
    stop if FALSE
  }
  while {
    event {
      on "Main light" Value changed {
        case ($"Main light") {
          frame False, Default {
            Concatenate Strings("http://192.168.0.14:80/warehouse/main-light-switch", "?state=false") -> w49
          }
          frame True {
            Concatenate Strings("http://192.168.0.14:80/warehouse/main-light-switch", "?state=true") -> w49
          }
        }
        call "Open HTTP Handle.gvi"() -> (client handle out=w50, error out=w51)
        call "POST Buffer.gvi"(client handle=w50, url=w49, error in=w51) -> (client handle out=w52, error out=w53)
        call "Close HTTP Handle.gvi"(client handle=w52, error in=w53)
      }
      on "Ventilation" Value changed {
        case ($Ventilation) {
          frame False, Default {
            Concatenate Strings("http://192.168.0.14:80/warehouse/main-fan-switch", "?state=false") -> w54
          }
          frame True {
            Concatenate Strings("http://192.168.0.14:80/warehouse/main-fan-switch", "?state=true") -> w54
          }
        }
        call "Open HTTP Handle.gvi"() -> (client handle out=w55, error out=w56)
        call "POST Buffer.gvi"(client handle=w55, url=w54, error in=w56) -> (client handle out=w57, error out=w58)
        call "Close HTTP Handle.gvi"(client handle=w57, error in=w58)
      }
      on "Save settings" Value changed {
        case ($"Autoenabled light") {
          frame False, Default {
            w59 = "&light_on_auto_mode=false"
          }
          frame True {
            w59 = "&light_on_auto_mode=true"
          }
        }
        case ($"Autoenabled ventilation") {
          frame False, Default {
            w60 = "&ventilation_on_auto_mode=false"
          }
          frame True {
            w60 = "&ventilation_on_auto_mode=true"
          }
        }
        Number To Decimal String(number=$"Main light switch pin") -> (decimal integer string=w61)
        Concatenate Strings("main_light_pin=", w61) -> w62
        Number To Decimal String(number=$"Main fan switch pin") -> (decimal integer string=w63)
        Concatenate Strings("&main_fan_pin=", w63) -> w64
        Number To Decimal String(number=$"Outdoor temp pin") -> (decimal integer string=w65)
        Concatenate Strings("&outdoor_temp_pin=", w65) -> w66
        Number To Decimal String(number=$"Indoor light sensor pin") -> (decimal integer string=w67)
        Concatenate Strings("&indoor_light_sensor_pin=", w67) -> w68
        Number To Decimal String(number=$"Roof sensor echo pin") -> (decimal integer string=w69)
        Concatenate Strings("&roof_sensor_echo_pin=", w69) -> w70
        Number To Decimal String(number=$"Roof sensor data pin") -> (decimal integer string=w71)
        Concatenate Strings("&roof_sensor_data_pin=", w71) -> w72
        Number To Decimal String(number=$"Closed roof distance") -> (decimal integer string=w73)
        Concatenate Strings("&closed_roof_distance=", w73) -> w74
        Number To Decimal String(number=$"Light on threshold") -> (decimal integer string=w75)
        Concatenate Strings("&light_on_threshold=", w75) -> w76
        Number To Decimal String(number=$"Main light ON threshold") -> (decimal integer string=w77)
        Concatenate Strings("&main_light_on_auto_treshold=", w77) -> w78
        Number To Decimal String(number=$"Ventilation ON humidity treshhold") -> (decimal integer string=w79)
        Concatenate Strings("&ventilation_on_auto_treshold=", w79) -> w80
        case ($"Save settings") {
          frame False, Default {
            w81 = "http://192.168.0.14:80/warehouse/pinout-settings?"
          }
          frame True {
            Concatenate Strings("http://192.168.0.14:80/warehouse/pinout-settings?", w62, w64, w66, w68, w70, w72, w74, w76, w59, w60, w78, w80) -> w81
          }
        }
        call "Open HTTP Handle.gvi"() -> (client handle out=w82, error out=w83)
        call "POST Buffer.gvi"(client handle=w82, url=w81, error in=w83) -> (client handle out=w84, error out=w85)
        call "Close HTTP Handle.gvi"(client handle=w84, error in=w85)
      }
    }
    stop if $stop
  }
  call "Open HTTP Handle.gvi"() -> (client handle out=w86, error out=w87)
  call "GET.gvi"(client handle=w86, url="http://192.168.0.14:80/warehouse/pinout-settings-get", error in=w87) -> (client handle out=w88, body=w89, error out=w90)
  w91 = T1 {"light_on_auto_mode"=TRUE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}
  Unflatten From Json(JSON string=w89, error in (no error)=w90, type and defaults=w91) -> (error out=w92, value=w93)
  call "Close HTTP Handle.gvi"(client handle=w88, error in=w92)
  Property Node(instance in=w93) -> ("main_light_pin"=w94, "main_fan_pin"=w95, "outdoor_temp_pin"=w96, "indoor_light_sensor_pin"=w97, "roof_sensor_echo_pin"=w98, "roof_sensor_data_pin"=w99, "closed_roof_distance"=w100, "light_on_threshold"=w101, "light_on_auto_mode"=w102, "ventilation_on_auto_mode"=w103, "ventilation_on_auto_treshold"=w104, "main_light_on_auto_treshold"=w105)
  Property Node(instance in=reference to "Main light switch pin", "Value"=w94)
  Property Node(instance in=reference to "Main fan switch pin", "Value"=w95)
  Property Node(instance in=reference to "Outdoor temp pin", "Value"=w96)
  Property Node(instance in=reference to "Indoor light sensor pin", "Value"=w97)
  Property Node(instance in=reference to "Autoenabled ventilation", "Value"=w103)
  Property Node(instance in=reference to "Roof sensor echo pin", "Value"=w98)
  Property Node(instance in=reference to "Autoenabled light", "Value"=w102)
  Property Node(instance in=reference to "Roof sensor data pin", "Value"=w99)
  Property Node(instance in=reference to "Light on threshold", "Value"=w101)
  Property Node(instance in=reference to "Closed roof distance", "Value"=w100)
  Property Node(instance in=reference to "Ventilation ON humidity treshhold", "Value"=w104)
  Property Node(instance in=reference to "Main light ON threshold", "Value"=w105)
